# Grasshopper definition section_study.gh (Grasshopper 0.9.61)
# plug-ins: Python Interpreter

python = PythonScript(x=Slider(10, range=3..30), y=Slider(10, range=1..20))  # -> out, a, b; inputs x: Int32, y: Int32
# ---------- python: Python ----------
import rhinoscriptsyntax as rs
import Rhino.Geometry as rg
import math
N=x
Radius=4
vectors=list()
a=list()
b=list()
alpha=2*math.pi/N/2
R2=Radius*math.cos(alpha)
for i in range(N):
    theta=2*math.pi*i/N
    vector=rg.Vector3d(R2*math.cos(theta),R2*math.sin(theta),0)
    vectors.append(vector)
    b.append(rs.AddLine((0,0,0),(R2*math.cos(theta),R2*math.sin(theta),0)))
edge=2*math.sin(alpha)*Radius
dx=edge/y
for i in rs.frange(-Radius,Radius,dx):
    for j in rs.frange(-Radius,Radius,dx):
        V=rg.Vector3d(i,j,0)
        flag=True
        for T in vectors:
            if T*V<R2**2:
                continue
            else:
                flag=False
                break

        if flag:
            a.append(rs.AddPoint(i,j,0))
# ---------- end python ----------
